# Grasshopper definition DH_CopySortPrint_Example.gh (Grasshopper 1.0.7)
# plug-ins: DraftHorse

# ----
# Tools for automating layout creation and modification
# 
# By Jo Kamm
# https://github.com/jkamm/DraftHorse_gh
# DRAFTHORSE
# 1. Create layout template
# (or use existing)
panel = Panel("Template")
newlayout = CreateNewLayout(Name=panel, Height=11, Width=17, Details=4, Scale=1, Units=0)  # -> LayoutIndex, LayoutName

# ----
# 2. Duplicate template
new_layout_names = Panel("""Part1
Part2
Part3
Part4""")
copylayout = CopyLayout(TemplateIndex=newlayout.LayoutIndex, NewName=new_layout_names)  # -> LayoutIndex, LayoutName

# ----
# 3. Get indices of layouts
getloindex = GetLayoutIndex(Name=new_layout_names)  # -> LayoutIndex, Count

# ----
# 4. Print layouts to PDF
# All in one document
# Separate documents
# by layout name
current_dir = CSharpScript()  # -> dir
# ---------- current_dir: C# usings ----------
using System.IO;
# ---------- current_dir: C# ----------
    string filePath = GrasshopperDocument.FilePath;
    dir = Path.GetDirectoryName(filePath);
# ---------- end current_dir ----------
graft = GraftTree(Tree=getloindex.LayoutIndex, IncludeEmptyLists=True, IncludeNullItems=True)
getlonames = GetLayoutNames(Index=graft)
dh_pdf = PDFLayout(
    LayoutIndex=flatten(getloindex.LayoutIndex),
    Folder=current_dir,
    Filename="AllParts",
    DPI=100,
    ColorMode=0,
    UsePrintWidths=True,
    DefaultWidth=0.1,
    WireScale=1)
dh_pdf_2 = PDFLayout(
    LayoutIndex=graft,
    Folder=current_dir,
    Filename=getlonames,
    DPI=100,
    ColorMode=0,
    UsePrintWidths=True,
    DefaultWidth=0.1,
    WireScale=1)
panel_2 = Panel(dh_pdf_2)

panel_3 = Panel(dh_pdf)
