# Grasshopper definition DH_Details_ByRelativeView_Example.gh (Grasshopper 1.0.7)
# plug-ins: DraftHorse

pln_boxorigin = Plane(Plane(origin=(8.594654416, 9.847133255, 0), x=(0.9036334152, -0.4283067252, 0), y=(0.4283067252, 0.9036334152, 0)))

# ----
# DRAFTHORSE
# Example: Create/Modify Details using Relative Views
# 1.Create Empty Layout
panel = Panel("NewLayout")
# Tools for automating layout creation and modification
# 
# By Jo Kamm
# https://github.com/jkamm/DraftHorse_gh
newlayout = CreateNewLayout(Name=panel, Height=11, Width=17, Details="0", Scale=1, Units=0)  # -> LayoutIndex, LayoutName
int_layoutindex = Data(newlayout.LayoutIndex)

box = DomainBox(Base=pln_boxorigin, X=Slider(2, range=0..10), Y=Slider(3, range=0..10), Z=Slider(4, range=0..10))
pln_boxorigin_2 = Data(pln_boxorigin)
B = Data(box)

# ----
# Generate Rectangles for Details
int_layoutindex_2 = Data(int_layoutindex)
lodeclayout = DeconstructLayout(LayoutIndex=int_layoutindex_2)  # -> Name, Number, Width, Height, Paper, Geo, DetailGUID
number_slider = Slider(2, range=0..10)
rectangle = Rectangle(Plane=PlaneXY(0, 0, 0), XSize=lodeclayout.Width, YSize=lodeclayout.Height, Radius=0)  # -> Rectangle, Length
range = Range(Domain=lodeclayout.Width, Steps=number_slider)
range_2 = Range(Domain=lodeclayout.Height, Steps=number_slider)
consec = ConsecutiveDomains(Numbers=range_2, Additive=False)
consec_2 = ConsecutiveDomains(Numbers=range, Additive=False)
dom² = ConstructDomain²(DomainU=consec_2, DomainV=graft(consec))
subsrf = Isotrim(Surface=rectangle.Rectangle, Domain=dom²)
neg = Negative(Value=Slider(0.5, range=0..1))
offset = OffsetCurve(Curve=subsrf, Distance=neg, Corners=1)  # -> flatten(Curve)
rec_detailboundaries = Rectangle(reverse(offset))

# ----
# Generate Rectangles As Views (relative to Bounding Box)
pln_boxorigin_3 = Data(pln_boxorigin_2)
B_2 = Data(B)
bbox = BoundingBox(Content=B_2, Plane=pln_boxorigin_3, UnionBox=True)  # -> Box, Box_2
box_corners = BoxCorners(Box=bbox.Box)  # -> CornerA, CornerB, CornerC, CornerD, CornerE, CornerF, CornerG, CornerH
rec_3pt = Rectangle3Pt(PointA=box_corners.CornerA, PointB=box_corners.CornerB, PointC=box_corners.CornerE)  # -> Rectangle, Length
rec_3pt_2 = Rectangle3Pt(PointA=box_corners.CornerB, PointB=box_corners.CornerC, PointC=box_corners.CornerF)  # -> Rectangle, Length
rec_3pt_3 = Rectangle3Pt(PointA=box_corners.CornerE, PointB=box_corners.CornerF, PointC=box_corners.CornerH)  # -> Rectangle, Length
rec_3pt_4 = Rectangle3Pt(PointA=box_corners.CornerD, PointB=box_corners.CornerB, PointC=box_corners.CornerG)  # -> Rectangle, Length
rec_perspective = Rectangle(rec_3pt_4.Rectangle)
rec_front = Rectangle(rec_3pt.Rectangle)
rec_right = Rectangle(rec_3pt_2.Rectangle)
rec_top = Rectangle(rec_3pt_3.Rectangle)
pln = Plane(rec_perspective)
merge = Merge(Data1=rec_front, Data2=rec_right, Data3=rec_top)
pt = PointOriented(BasePlane=pln, UComponent=0, VComponent=0, WComponent=Slider(10, range=0..10))
m2d_parallel = Make2DParallelView(Projection=merge)
m2d_perspective = Make2DPerspectiveView(Camera=pt, Frame=rec_perspective)
merge_2 = Merge(Data1=m2d_parallel, Data2=m2d_perspective)
view_4views = Data(merge_2)

view_4views_2 = Data(view_4views)

# ----
# 3. Modify details
update_after_details_created = Button()
int_layoutindex_3 = Data(int_layoutindex)
pick_display = Display({"Wireframe", "Shaded", "Rendered", "Ghosted", "X-Ray", "Technical", "Artistic", "Pen", "Arctic", "Raytraced"}, selected="Rendered")
gate = StreamGate(Stream=int_layoutindex_3, Gate=update_after_details_created)  # -> Target0, Target1
lodeclayout_2 = DeconstructLayout(LayoutIndex=gate.Target0)  # -> Name, Number, Width, Height, Paper, Geo, DetailGUID
detailedit = EditDetails(GUID=lodeclayout_2.DetailGUID, Display=pick_display, Scale=Slider(0.8, range=0..1))  # -> Result, GUID, Display, Target, Scale, Projection, View
panel_2 = Panel(detailedit.Display)
panel_3 = Panel(detailedit.Result)
panel_4 = Panel(detailedit.View)

rec_detailboundaries_2 = Rectangle(rec_detailboundaries)

# ----
# 2. Add details to Layout
int_layoutindex_4 = Data(int_layoutindex)
box_target = Data(B)
pick_display_2 = Display({"Wireframe", "Shaded", "Rendered", "Ghosted", "X-Ray", "Technical", "Artistic", "Pen", "Arctic", "Raytraced"}, selected="Wireframe")
newdetail = NewDetail(
    Index=int_layoutindex_4,
    Bounds=rec_detailboundaries_2,
    Display=pick_display_2,
    Target=box_target,
    Scale=Slider(0.5, range=0..1),
    Projection=0,
    View=view_4views_2)  # -> Result, Index, GUID, Display, Target, Scale, Projection, View
panel_5 = Panel(newdetail.Result)
panel_6 = Panel(newdetail.Display)
panel_7 = Panel(newdetail.Projection)
