# Grasshopper definition DH_DocumentAndLayoutText_Example.gh (Grasshopper 1.0.7)
# plug-ins: DraftHorse

# ----
# Access/Edit Layout Text
# for layout specific data
# "Edit Layout" Used here
# only to access Layout attributes
pick_named_layout = Layouts({"Template"}, selected="Template")
getloindex = GetLayoutIndex(Name=pick_named_layout)  # -> LayoutIndex, Count
layoutedit = EditLayout(Index=getloindex.LayoutIndex)  # -> Index, Name, Width, Height, Keys, Values
newvalues = Panel("""1:1
3/4 Baltic Birch
10
Kitchen Casework
1""")
item = ListItem(List=layoutedit.Keys, Index=0, Wrap=True)
getlovalue = AccessLayoutUserText(Index=getloindex.LayoutIndex, Keys=item)
values = Panel(layoutedit.Values)
keys = Panel(layoutedit.Keys)
layoutedit_2 = EditLayout(Index=getloindex.LayoutIndex, Keys=layoutedit.Keys, Values=newvalues)  # -> Index, Name, Width, Height, Keys, Values
specific_value = Panel(getlovalue)

# ----
# DRAFTHORSE
# Access/Edit Document Text
# for consistent project data across layouts
# note: document text keys starting
# with '.' are hidden from the user
panel = Panel("GrasshopperFilePath")
ghdoc_path = CSharpScript()  # -> dir
# ---------- ghdoc_path: C# usings ----------
using System.IO;
# ---------- ghdoc_path: C# ----------
    string filePath = GrasshopperDocument.FilePath;
    dir = filePath;
# ---------- end ghdoc_path ----------
setdoctext = SetDocumentText(Keys=panel, Values=ghdoc_path)  # -> Keys, Values
# Tools for automating layout creation and modification
# 
# By Jo Kamm
# https://github.com/jkamm/DraftHorse_gh
# Use with DH_DocumentAndLayoutText_Example.3dm
accessdoctext = AccessDocumentText(Key=panel)
specific_doc_text_value = Panel(accessdoctext)
doc_text_keys = Panel(setdoctext.Keys)
doc_text_values = Panel(setdoctext.Values)

# ----
# See Layout Template for use of Text Fields with Document and Layout Text
# primary use of this component is for
# programmatic baking to Layouts
# (use in combination with Bake component
# from Elefront, Human, or other plugin set)
pick_named_layout_2 = Layouts({"Template"}, selected="Template")
getloindex_2 = GetLayoutIndex(Name=pick_named_layout_2)  # -> LayoutIndex, Count
active_page = MakePageActive(Index=getloindex_2.LayoutIndex)  # -> Result, Name

# ----
# Or Edit Named Text Objects on a Layout
pick_named_layout_3 = Layouts({"Template"}, selected="Template")
getloindex_3 = GetLayoutIndex(Name=pick_named_layout_3)  # -> LayoutIndex, Count
lotext = ModifyText(Run=False, Index=getloindex_3.LayoutIndex, Name="PageTitle", Text="Hello World!")
