# Grasshopper definition DH_LayoutFromBBox_MakePageActive_Example.gh (Grasshopper 1.0.7)
# plug-ins: DraftHorse, Human

# ----
# Tools for automating layout creation and modification
# 
# By Jo Kamm
# https://github.com/jkamm/DraftHorse_gh
# DRAFTHORSE
# DH_Example: Layout From Bounding Box and Make Page Active
# These components/workflows could be used
# for a lot of individual objects on layouts,
# or, like in this case, as portions of a larger design
# for printing on smaller material (paper)
# Get OA Pattern Dims
input_patterncurves = Geometry([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])
bbox = BoundingBox(Content=input_patterncurves, Plane=PlaneXY(0, 0, 0), UnionBox=True)  # -> Box, Box_2
debox = DeconstructBox(Box=bbox.Box)  # -> Plane, X, Y, Z
num = Number(debox.X)
num_2 = Number(debox.Y)
num_dimy = Data(num_2)
num_dimx = Data(num)
boundingbox = Data(bbox.Box)
input_curves = Geometry(input_patterncurves)

paperheight = Panel("11")
paperwidth = Panel("17")

# ----
# Paper Dims
switch_to_8_5x11 = BooleanToggle(True)
paperwidth_alternate = Panel("8.5")
filter = StreamFilter(Gate=switch_to_8_5x11, Stream0=paperwidth, Stream1=paperwidth_alternate)

# ----
# Generate papers to cover pattern
boundingbox_2 = Data(boundingbox)
num_dimy_2 = Data(num_dimy)
paperheight_2 = Data(paperheight)
paperwidth_2 = Data(filter)
num_dimx_2 = Data(num_dimx)
paperheight_3 = Data(paperheight_2)
paperwidth_3 = Data(paperwidth_2)
box_corners = BoxCorners(Box=boundingbox_2)  # -> CornerA, CornerB, CornerC, CornerD, CornerE, CornerF, CornerG, CornerH
division = Division(A=num_dimx_2, B=paperwidth_3)
rectangle = Rectangle(Plane=box_corners.CornerA, XSize=paperwidth_3, YSize=paperheight_3, Radius=0)  # -> Rectangle, Length
division_2 = Division(A=num_dimy_2, B=paperheight_3)
round = Round(Number=division)  # -> Nearest, Floor, Ceiling
round_2 = Round(Number=division_2)  # -> Nearest, Floor, Ceiling
recgrid = Rectangular(Plane=rectangle.Rectangle, SizeX=paperwidth_3, SizeY=paperheight_3, ExtentX=round.Ceiling, ExtentY=round_2.Ceiling)  # -> reverse(Cells), Points
crv_paperbounds = Data(recgrid.Cells)

# ----
# Recenter Papers on Pattern
crv_paperbounds_2 = Data(crv_paperbounds)
boundingbox_3 = Data(boundingbox)
bbox_2 = BoundingBox(Content=flatten(crv_paperbounds_2), Plane=PlaneXY(0, 0, 0), UnionBox=True)  # -> Box, Box_2
area = Area(Geometry=boundingbox_3)  # -> Area, Centroid
area_2 = Area(Geometry=bbox_2.Box)  # -> Area, Centroid
vec2pt = Vector2Pt(PointA=area_2.Centroid, PointB=area.Centroid, Unitize=False)  # -> Vector, Length
move = Move(Geometry=crv_paperbounds_2, Motion=vec2pt.Vector)  # -> Geometry, Transform
crv_paperbounds_centered = Data(move.Geometry)

# ----
# Generate Names
crv_paperbounds_3 = Data(crv_paperbounds)
tstat = TreeStatistics(Tree=simplify(graft(crv_paperbounds_3)))  # -> Paths, Length, Count
tstat_2 = TreeStatistics(Tree=simplify(crv_paperbounds_3))  # -> Paths, Length, Count
match = MatchTree(Tree=graft(tstat_2.Paths), Guide=crv_paperbounds_3)
unflatten = UnflattenTree(Tree=tstat.Paths, Guide=simplify(graft(crv_paperbounds_3)))
dpath = DeconstructPath(Branch=match)
dpath_2 = DeconstructPath(Branch=unflatten)
addition = Addition(A=dpath, B1=1)
addition_2 = Addition(A=dpath_2, B1=1)
item = ListItem(List=addition_2, Index=0, Wrap=True)  # -> Item, Item1
series = Series(Start=1, Step=1, Count=tstat.Count)
format = Format(Format="{0:00}_C{1}-R{2}", Culture=127, Data0=graft(series), Data1=item.Item, Data2=item.Item1)
format_2 = Format(Format="Drafthorse_Column-{0}", Culture=127, Data0=addition)
panel = Panel(format)
txt_groupnames = Data(format_2)
txt_names = Data(format)

# ----
# Generate Layouts
crv_paperbounds_centered_2 = Data(crv_paperbounds_centered)
generate_layouts = BooleanToggle(False)
txt_names_2 = Data(txt_names)
bbox_layout = LayoutByBounds(Run=generate_layouts, Name=txt_names_2, BBox=graft(crv_paperbounds_centered_2), Units=True)  # -> LayoutIndex, LayoutName
int_newlayoutindices = Data(bbox_layout.LayoutIndex)

# ----
# Delete All Layouts
# (good for mistakes along the way)
getlonames = GetLayoutNames()
getloindex = GetLayoutIndex(Name=getlonames)  # -> LayoutIndex, Count
deletelayout = DeleteLayout(LayoutIndex=getloindex.LayoutIndex, Override=False)

trigger = Trigger(Interval=20, TimerInterval=20, Target=bool)

# ----
# Get Names after Layout Generation
generate_print = Data(generate_layouts)
txt_names_3 = Data(txt_names)
filter_2 = StreamFilter(Gate=generate_print, Stream0=txt_names_3)
getloindex_2 = GetLayoutIndex(Name=filter_2)  # -> LayoutIndex, Count
int_newlayoutindices_2 = Data(getloindex_2.LayoutIndex)

# ----
# Preview of Geometry
hatchtable = HatchTable(Update=True)
list = ItemSelector(
    hatchtable,
    {"Solid", "Hatch1", "Hatch2", "Hatch3", "HatchDash", "Grid", "Grid60", "Plus", "Squares"}, selected="Squares")
input_curves_2 = Geometry(input_curves)
createhatch = CreateHatch(Bake=False, Curves=input_curves_2, HatchPatternName=list, HatchScale=1, HatchRotation=0)  # -> HatchGeometry, HatchObjects
preview = CustomPreview(
    Geometry=createhatch.HatchGeometry,
    Material={diffuse=RGB(25, 25, 112), emission=RGB(66, 48, 66), shine=0.5, specular=RGB(255, 255, 255), transparency=0})

# ----
# Print Layouts to one or more files
int_newlayoutindices_3 = Data(int_newlayoutindices_2)
pdf_layouts_by_column = BooleanToggle(False)
pshift = ShiftPaths(Data=simplify(int_newlayoutindices_3), Offset=-1)
txt_groupnames_2 = Data(txt_groupnames)
current_dir = CSharpScript()  # -> dir
# ---------- current_dir: C# usings ----------
using System.IO;
# ---------- current_dir: C# ----------
    string filePath = GrasshopperDocument.FilePath;
    dir = Path.GetDirectoryName(filePath);
# ---------- end current_dir ----------
dh_pdf = PDFLayout(
    Run=pdf_layouts_by_column,
    LayoutIndex=pshift,
    Folder=current_dir,
    Filename=txt_groupnames_2,
    DPI=100,
    ColorMode=0,
    UsePrintWidths=True,
    DefaultWidth=0.1,
    WireScale=1)

# ----
# Bake a name text to each layout
# Yes, in this case they could just be baked
# to Model space, but it's not too difficult to
# imagine a scenario where it would be preferable
# for annotations to live on the layout pages
# This is a bit overcomplicated to replicate the action of a "counter"
# Using "Animate" on a slider could also be effective.
txt_names_4 = Data(txt_names)
generate_print_2 = Data(generate_layouts)
int_newlayoutindices_4 = Data(int_newlayoutindices)
bool = Boolean(True)
filter_3 = StreamFilter(Gate=generate_print_2, Stream1=bool)
txt_names_5 = Data(txt_names_4)
pt = Point(Point(0.9496885253, 1.295029807, 0))

not = GateNot(A=generate_print_2)
lng = ListLength(List=flatten(int_newlayoutindices_4))

pystep = PythonStepper(R=not, Up=filter_3)  # -> C
# ---------- pystep: Python ----------
initVal = 0
step = 1
reset = R
up = Up
down = Dn

if not 'acc' in vars():
    acc = initVal

if reset > 0:
    acc = initVal

if up > 0:
    acc += step
if down > 0:
    acc -= step
    
if reset > 0:
    acc = initVal

C = acc
# ---------- end pystep ----------
panel_2 = Panel(pystep)

smaller = SmallerThan(FirstNumber=pystep, SecondNumber=lng)  # -> SmallerThan, OrEqualTo
filter_4 = StreamFilter(Gate=smaller.OrEqualTo, Stream1=pystep)

item_2 = ListItem(List=flatten(int_newlayoutindices_4), Index=filter_4, Wrap=True)
item_3 = ListItem(List=flatten(txt_names_5), Index=filter_4, Wrap=True)
active_page = MakePageActive(Run=generate_print_2, Index=item_2)  # -> Result, Name
justified_text = JustifiedText3d(Location=pt, Text=item_3, Size=1, HorizontalAlignment=0, VerticalAlginment=1, UseMeshes=False, Bake=generate_print_2)
