# Grasshopper definition DH_ModifyDetails_Example.gh (Grasshopper 1.0.7)
# plug-ins: DraftHorse

pt = Point(Point(10, 10, 10))
box = DomainBox(Base=pt, X=Slider(2, range=0..10), Y=Slider(3, range=0..10), Z=Slider(4, range=0..10))
volume = Volume(Geometry=box)  # -> Volume, Centroid
pt_center = Data(volume.Centroid)

# ----
# DRAFTHORSE
# 1.Create Layout with Details
panel = Panel("NewLayout")
# Tools for automating layout creation and modification
# 
# By Jo Kamm
# https://github.com/jkamm/DraftHorse_gh
newlayout = CreateNewLayout(Name=panel, Height=11, Width=17, Details="4", Scale=1, Units=0)  # -> LayoutIndex, LayoutName
int_layoutindex = Data(newlayout.LayoutIndex)

pick_displaymode = DisplayMode({"Wireframe", "Shaded", "Rendered", "Ghosted", "X-Ray", "Technical", "Artistic", "Pen", "Arctic", "Raytraced"}, selected="Wireframe")
pick_projection = Views({"None": "0", "Top": "1", "Bottom": "2", "Left": "3", "Right": "4", "Front": "5", "Back": "6", "Perspective": "7", "TwoPointPerspective": "8"}, selected=["Top", "Right", "Front", "Perspective"])

# ----
# 2. Modify Existing Details
int_layoutindex_2 = Data(int_layoutindex)
pt_center_2 = Data(pt_center)
lodeclayout = DeconstructLayout(LayoutIndex=int_layoutindex_2)  # -> Name, Number, Width, Height, Paper, Geo, DetailGUID
detailedit = EditDetails(
    DetailGUID=lodeclayout.DetailGUID,
    Target=pt_center_2,
    Scale=Slider(0.5, range=0..1),
    Projection=pick_projection,
    DisplayMode=pick_displaymode)  # -> Result, DetailGUID, Target, Scale, ViewName, DisplayMode
