# Grasshopper definition DH_ModifyLayout.gh (Grasshopper 1.0.7)
# plug-ins: DraftHorse

# ----
# Tools for automating layout creation and modification
# 
# By Jo Kamm
# https://github.com/jkamm/DraftHorse_gh
# DRAFTHORSE
# Example: Modify Layout Attributes
# 1. Create a Generic Layout
newlayout = CreateNewLayout(Height=11, Width=17, Details=4, Scale=1, Units=0)  # -> LayoutIndex, LayoutName

# ----
# 2. Access Layout Attributes
layoutedit = EditLayout(Index=newlayout.LayoutIndex)  # -> Index, Name, Width, Height, Keys, Values
panel = Panel([layoutedit.Index, layoutedit.Name, layoutedit.Width, layoutedit.Height, layoutedit.Keys, layoutedit.Values])

# ----
# 3. Write to some or all Layout Attributes
keys = Panel("""Key1
Key2""")
values_length_must_match_keys = Panel("""Value1
Value2""")
layoutedit_2 = EditLayout(
    Index=newlayout.LayoutIndex,
    Name="NewLayoutName",
    Width=Slider(17, range=0..100),
    Height=Slider(11, range=0..100),
    Keys=keys,
    Values=values_length_must_match_keys)  # -> Index, Name, Width, Height, Keys, Values
panel_2 = Panel([layoutedit_2.Name, layoutedit_2.Width, layoutedit_2.Height, layoutedit_2.Keys, layoutedit_2.Values])

colour = ColourPicker(PickedColour=RGB(131, 111, 34))
