# Grasshopper definition DH_NewDetails_Example.gh (Grasshopper 1.0.7)
# plug-ins: DraftHorse

pt = Point(Point(10, 10, 10))
box = DomainBox(Base=pt, X=Slider(3, range=0..10), Y=Slider(4, range=0..10), Z=Slider(2, range=0..10))
box_target = Data(box)

# ----
# DRAFTHORSE
# 1.Create Empty Layout
panel = Panel("NewLayout")
# Tools for automating layout creation and modification
# 
# By Jo Kamm
# https://github.com/jkamm/DraftHorse_gh
newlayout = CreateNewLayout(Name=panel, Height=11, Width=17, Details="0", Scale=1, Units=0)  # -> LayoutIndex, LayoutName
int_layoutindex = Data(newlayout.LayoutIndex)

# ----
# 2. Add details to Layout
box_target_2 = Data(box_target)
int_layoutindex_2 = Data(int_layoutindex)
pick_projection = Views({"None": "0", "Top": "1", "Bottom": "2", "Left": "3", "Right": "4", "Front": "5", "Back": "6", "Perspective": "7", "TwoPointPerspective": "8"}, selected=["Top", "Right", "Front", "Perspective"])
pick_display = Display({"Wireframe", "Shaded", "Rendered", "Ghosted", "X-Ray", "Technical", "Artistic", "Pen", "Arctic", "Raytraced"}, selected="Wireframe")
rec = Rectangle([{Plane=PlaneXY(10.42468368, 3.355157738, 0), Size=Domain2(u=-2.157431807..2.157431807, v=-1.925..1.925)}, {Plane=PlaneXY(4.89566075, 8.020922378, 0), Size=Domain2(u=-2.3125..2.3125, v=-1.875..1.875)}, {Plane=PlaneXY(10.42468368, 8.05281584, 0), Size=Domain2(u=-2.157431807..2.157431807, v=-1.925..1.925)}, {Plane=PlaneXY(4.89566075, 3.355157738, 0), Size=Domain2(u=-2.3125..2.3125, v=-1.925..1.925)}])

newdetail = NewDetail(
    Index=int_layoutindex_2,
    Bounds=rec,
    Display=pick_display,
    Target=box_target_2,
    Scale=Slider(0.5, range=0..1),
    Projection=pick_projection)  # -> Result, Index, GUID, Display, Target, Scale, Projection, View

panel_2 = Panel(newdetail.Result)
panel_3 = Panel(newdetail.Display)
panel_4 = Panel(newdetail.Projection)
