# Grasshopper definition DH_NewLayout_Example.gh (Grasshopper 1.0.7)
# plug-ins: DraftHorse

# ----
# DRAFTHORSE
# 1. Create New Layout
number_slider = Slider(4, range=0..10)
# Tools for automating layout creation and modification
# 
# By Jo Kamm
# https://github.com/jkamm/DraftHorse_gh
newlayout = CreateNewLayout(Height=11, Width=17, Details=number_slider, Scale=1, Units=0)  # -> LayoutIndex, LayoutName
lodeclayout = DeconstructLayout(LayoutIndex=newlayout.LayoutIndex)  # -> Name, Number, Width, Height, Paper, Geo, DetailGUID
guid_details = Data(lodeclayout.DetailGUID)

pt = Point(Point(10, 10, 10))
box = DomainBox(Base=pt, X=Slider(2, range=0..10), Y=Slider(3, range=0..10), Z=Slider(4, range=0..10))
volume = Volume(Geometry=box)  # -> Volume, Centroid
pt_center = Data(volume.Centroid)

# ----
# 2. Modify details to display geometry
guid_details_2 = Data(guid_details)
pt_center_2 = Data(pt_center)
lodetails = ModifyDetails(DetailGUID=guid_details_2, Target=pt_center_2, Scale=Slider(0.5, range=0..1))  # -> Result, DetailGUID, Target, Scale, ViewName, DisplayMode
panel = Panel(lodetails.Result)
