# Grasshopper definition DH_ReferenceLayouts_Example.gh (Grasshopper 1.0.7)
# plug-ins: DraftHorse

# ----
# DRAFTHORSE
# 1. Generate (or select)
# template to copy
panel = Panel("Template")
# Tools for automating layout creation and modification
# 
# By Jo Kamm
# https://github.com/jkamm/DraftHorse_gh
newlayout = CreateNewLayout(Name=panel, Height=11, Width=17, Details=4, Scale=1, Units=0)  # -> LayoutIndex, LayoutName

# ----
# 2. Copy Existing Layout
# This is buggy right now
# and must be held down
# until all copies are made
new_layout_names = Panel("""Part1
Part2
Part3
Part4
Copy
Copy
Copy""")
copylayout = CopyLayout(TemplateIndex=newlayout.LayoutIndex, NewName=new_layout_names)  # -> LayoutIndex, LayoutName

# ----
# In DraftHorse, Layouts are referenced by index
# (in the RhinoPageview Table),
# not by name, since names may be duplicated
getlonames = GetLayoutNames(Index=copylayout.LayoutIndex)
getloindex = GetLayoutIndex(Name=getlonames)  # -> LayoutIndex, Count

# ----
# 3. Delete unwanted layouts.
# Warning message window
# can be turned off from the
# component menu
deletelayout = DeleteLayout(LayoutIndex=getloindex.LayoutIndex, Override=True)

getlonames_2 = GetLayoutNames(Index=getloindex.LayoutIndex)
# 4. Update "Get Layout Names"
# after deletion so page numbers (indices)
# are current
panel_2 = Panel(getlonames_2)
