# Grasshopper definition DH_NewLayout_WIP.gh (Grasshopper 1.0.7)
# plug-ins: DraftHorse

# ---- group: Hard-Coded Input
# Given a version number MAJOR.MINOR.PATCH, increment the:
# 
# MAJOR version when you make incompatible API changes,
# MINOR version when you add functionality in a backwards compatible manner, and
# PATCH version when you make backwards compatible bug fixes.
# 
# Additional labels for pre-release and build metadata are available as extensions
# to the MAJOR.MINOR.PATCH format.
# 
# more info: https://semver.org/spec/v2.0.0.html
txt_message = Panel("Don't mess with me")

geo_input = Curve([<curve referenced from the Rhino model> x18])

# ---- group: User Input (Optional)
type_descriptivename = Slider(0.05, range=0..0.1)

# ---- group: User Input (Must Use)
geo_input_2 = Curve([<curve referenced from the Rhino model> x18])

# ---- group: User Action (Must Use)
# Code Information: Author: Jo Kamm
# Contact: jkamm@dimin.com
# 
# Date:
# Project:
button = Button()

# ----
# Key
# Faint Wires between Groups
txt_message_2 = Data(txt_message)
geo_input_3 = Curve(geo_input)

# ----
# Description of
# Group Function
geo_input_4 = Curve(geo_input_3)
txt_message_3 = Data(txt_message_2)
move = Move(Geometry=geo_input_4, Motion=Vector(0, 0, 10))  # -> Geometry, Transform

# ---- group: Data/Geo to Check
txt_message_4 = Panel(txt_message_3)

# ---- group: To Output
geo_input_moved = Curve(move.Geometry)

# ----
# Goal: Note for future development of code.  Express as an action to complete
number_slider = Slider(1, range=0..10)
# Code Description: Short description of program goals
# Track version changes
number_slider_2 = Slider(3, range=0..10)
number_slider_3 = Slider(20, range=0..100)
box = DomainBox(Base=PlaneXY(0, 0, 0), X=number_slider_2, Y=Slider(2, range=0..10), Z=number_slider)
volume = Volume(Geometry=box)  # -> Volume, Centroid
newlayout = CreateNewLayout(
    Name="test",
    Details=4,
    Target=volume.Centroid,
    Scale=Slider(0.5, range=0..1),
    Height=number_slider_3,
    Width=number_slider_3,
    Units=0)  # -> LayoutIndex, LayoutName
