# Grasshopper definition DH_Test.gh (Grasshopper 1.0.7)
# plug-ins: DraftHorse

# ---- group: Necessary User Inputs in Green
bool_input = BooleanToggle(True)

# ----
geo_referenced_geometry = Curve()

# ---- group: Optional User Inputs in Blue
int_input = Slider(42, range=0..100)
text_input = Panel("Typed data and paths")

# ---- group: Hard-Coded Vars in Black
text_variablename = Panel("Hard Coded Variable")

# ----
# Key
# Additional Info: Key - Explains significance of colors and formatting
geo_referenced_geometry_2 = Data(geo_referenced_geometry)
text_variablename_2 = Data(text_variablename)
# goal: Development related goal, often pseudocode for planned scripting.
bool_input_2 = Data(bool_input)
text_input_2 = Data(text_input)
int_input_2 = Data(int_input)

# ----
# Next Step (short description)
# Additional Info: Subtext for explaining group functionality
# and short description of what this block does
# [in Lower Left corner of a group]
text_variablename_3 = Data(text_variablename_2)
bool_input_3 = Data(bool_input_2)
int_input_3 = Data(int_input_2)
geo_referenced_geometry_3 = Data(geo_referenced_geometry_2)

# ---- group: User Feedback in Magenta
feedback_check = Panel(text_variablename_3)

# ----
changelog = Panel("0.0.1")
pick_named_layout = Layouts({"Template", "Floor Plan", "Sections", "Elevations"}, selected="Template")
getloindex = GetLayoutIndex()  # -> LayoutIndex, Count
losort = LayoutSortTabs()  # -> Done, Result
getlonames = GetLayoutNames()
setloutext = SetLayoutUserText()  # -> Keys, Values
lotext = ModifyText(Run=False)
accessdoctext = AccessDocumentText()
setdoctext = SetDocumentText()  # -> Keys, Values
getdoctext = GetDocumentText()  # -> Keys, Values
lodeclayout = DeconstructLayout()  # -> Name, Number, Width, Height, Paper, Geo, DetailGUID
decdetail = DeconstructDetail()  # -> Geometry, View, Display, ToWorld, ToPage, Scale, Bounds, Target, Attributes
lopdf = PDFLayout(Filename="Layout", DPI=100, ColorMode=0, UsePrintWidths=True, DefaultWidth=0.1, WireScale=1)
